% Simulink data dictionary FunctionalInterfaces.sldd

MaterialFlow = Simulink.Bus()
  contentType: double
  quantity: double

SoupBatch = Simulink.Bus()
  recipeId: double
  quantity: double
  processState: double

PackagedGoods = Simulink.Bus()
  containerCount: double
  batchId: double

ShipmentManifest = Simulink.Bus()
  destination: double
  batchId: double
  containerCount: double

InventoryStatus = Simulink.Bus()
  itemCount: double
  stockError: double

OrderRequest = Simulink.Bus()
  orderId: double
  recipeId: double
  quantity: double
  destination: double

ControlDirective = Simulink.Bus()
  mode: double
  targetFunction: double
  setpoint: double

OperationalStatus = Simulink.Bus()
  state: double
  health: double

EnvironmentState = Simulink.Bus()
  gravityLevel: double
  compensationState: double