% Simulink data dictionary LogicalInterfaces.sldd

IngredientLot = Simulink.Bus()
  lotId: double
  ingredientType: double
  quantity: double
  tempClass: double

PreppedBatch = Simulink.Bus()
  batchId: double
  recipeId: double
  quantity: double

SoupLot = Simulink.Bus()
  batchId: double
  recipeId: double
  volume: double
  temperature: double
  qcPassed: double

ContainerSet = Simulink.Bus()
  batchId: double
  containerCount: double
  sealRating: double

Manifest = Simulink.Bus()
  destination: double
  batchId: double
  containerCount: double
  departureWindow: double

StockReport = Simulink.Bus()
  itemId: double
  quantity: double
  errorEstimate: double

OrderMsg = Simulink.Bus()
  orderId: double
  recipeId: double
  quantity: double
  destination: double

CommandMsg = Simulink.Bus()
  cmdType: double
  targetUnit: double
  param: double

UnitStatus = Simulink.Bus()
  unitId: double
  opState: double
  faultFlag: double

GravityState = Simulink.Bus()
  gravity_g: double
  compMode: double