% Simulink data dictionary BehParamsCommon.sldd
% references BehaviorInterfaces.sldd

Bowl_kg = 0.55
Soup_cp_JpkgK = 3900
FillTemp_C = 12
Ambient_C = 25
SimmerTemp_C = 94
VatLoss_WpK = 15
Gravity_g = 1
QC_ContamIncidence = 0
QC_DetectSensitivity = 0.995
Recipe_Count = 8
Recipe_Block_s = 1800
Recipe_Flush_s = 0
Rocket_Load_bowls = 60
Rocket_Handling_s = 120
Resupply_Cutoff_T = 1000000000