% Simulink data dictionary BehParamsEverSimmer.sldd
% references BehParamsCommon.sldd

ES_PrepRate_bph = 80
ES_BatchSize_bowls = 40
ES_HeaterPower_kW = 32
ES_VatThermalMass_JpK = 96000
ES_FillRate_bps = 0.4
ES_SimmerTime_s = 1182
ES_DrainTime_s = 150
ES_CleanTime_s = 120
ES_QCRate_bph = 90
ES_QCReject = 0.02
ES_QCCalibPeriod_s = 5400
ES_QCCalibTime_s = 90
ES_PackRate_bph = 85
Transport_Rate_bph = 300
Transport_Latency_s = 60
ES_StorageCap_bowls = 16800
ES_StorageInit_bowls = 900
ES_Resupply_bph = 245
ES_NumLines = 3
ES_StaticPower_kW = 267
Fault_T_Cell1 = 1000000000
Fault_T_Cell2 = 1000000000
Fault_T_Cell3 = 1000000000