% Simulink data dictionary BehaviorInterfaces.sldd

PLANT_STARTUP = uint8(0)
PLANT_DEGRADED = uint8(2)
PLANT_HALTED = uint8(3)
VAT_IDLE = uint8(0)
VAT_FILL = uint8(1)
VAT_HEAT = uint8(2)
VAT_SIMMER = uint8(3)
VAT_DRAIN = uint8(4)
VAT_CLEAN = uint8(5)
PLANT_RUNNING = uint8(1)