test file "BehaviorComponentTests"

suite "CookLine"
  tags: behavior

  case "fullLoadSteadyState" [baseline]
    description: Abundant supply reaches rated flow and full power after settling.
    tags: behavior
    model BehCookLine, mode Normal, stop time 2000
    input "BehaviorComponentInputs.mat" (active)
    baseline "BehCookLine_fullLoad.mat"
      outflow_bps:1: abs tol 0.0005, leading tol 5, lagging tol 5
      power_kW:1: abs tol 1, leading tol 5, lagging tol 5
    custom criteria:
      y = test.sltest_simout.get('yout');
      outflow = y{1}.Values.Data; power = y{2}.Values.Data;
      test.verifyEqual(outflow(end), 90/3600, 'RelTol', 0.02, 'rated flow');
      test.verifyEqual(power(end), 50, 'RelTol', 0.02, 'full power');

  case "halfLoadSteadyState" [baseline]
    description: Quarter-capacity supply settles to the expected load-scaled power.
    tags: behavior
    model BehCookLine, mode Normal, stop time 2000
    input "BehaviorComponentInputs.mat" (active)
    baseline "BehCookLine_quarterLoad.mat"
      outflow_bps:1: abs tol 0.0005, leading tol 5, lagging tol 5
      power_kW:1: abs tol 1, leading tol 5, lagging tol 5
    custom criteria:
      y = test.sltest_simout.get('yout'); power = y{2}.Values.Data;
      test.verifyEqual(power(end), 18.5, 'RelTol', 0.05, 'quarter-load power');

  case "disabledLineIdles" [baseline]
    description: A disabled line produces no flow and draws no power.
    tags: behavior
    model BehCookLine, mode Normal, stop time 600
    input "BehaviorComponentInputs.mat" (active)
    baseline "BehCookLine_disabled.mat"
      outflow_bps:1: abs tol 0.0005, leading tol 5, lagging tol 5
      power_kW:1: abs tol 1, leading tol 5, lagging tol 5
    custom criteria:
      y = test.sltest_simout.get('yout');
      test.verifyEqual(y{1}.Values.Data(end), 0, 'AbsTol', 1e-6, 'zero flow');
      test.verifyEqual(y{2}.Values.Data(end), 0, 'AbsTol', 1e-6, 'zero power');

suite "CookVat"
  tags: behavior

  case "referenceCycleWithDefaults" [baseline]
    description: Three complete fill, heat, simmer, drain, and clean cycles.
    tags: behavior
    model BehCookVat, mode Normal, stop time 5400
    input "BehaviorComponentInputs.mat" (active)
    baseline "BehCookVat_reference.mat"
      outflow_bps:1: abs tol 0.005, leading tol 5, lagging tol 5
      power_kW:1: abs tol 0.8, leading tol 5, lagging tol 5
      vatTemp_C:1: abs tol 1, leading tol 5, lagging tol 5
      state:1: leading tol 5, lagging tol 5
      hopperLevel_bowls:1: abs tol 1, leading tol 5, lagging tol 5
    custom criteria:
      y = test.sltest_simout.get('yout');
      flow = y{1}.Values; power = y{2}.Values; temp = y{3}.Values;
      state = y{4}.Values; hopper = y{5}.Values;
      s = double(state.Data(:));
      test.verifyEqual(double(sort(unique(s)))', 0:5, 'all states visited');
      entered = (s(2:end)==4) & (s(1:end-1)~=4);
      test.verifyEqual(sum(entered), 3, 'three drain events');
      test.verifyEqual(trapz(flow.Time,flow.Data),150,'AbsTol',1,'total drained');
      starts=find(s==4 & [true;s(1:end-1)~=4]);
      ends=find(s~=4 & [false;s(1:end-1)==4]);
      amounts=zeros(1,numel(starts));
      for k=1:numel(starts), a=max(1,starts(k)-1); b=ends(k); amounts(k)=trapz(flow.Time(a:b),flow.Data(a:b)); end
      test.verifyEqual(amounts,repmat(50,1,3),'AbsTol',1,'one batch per drain');
      test.verifyGreaterThanOrEqual(max(temp.Data),94,'temperature peak lower bound');
      test.verifyLessThanOrEqual(max(temp.Data),99,'temperature peak upper bound');
      test.verifyLessThan(min(temp.Data(temp.Time>100)),20,'post-warmup cooling');
      test.verifyEqual(max(power.Data),40,'RelTol',0.02,'peak power');
      test.verifyGreaterThanOrEqual(min(hopper.Data),0,'nonnegative hopper');
      sf=interp1(state.Time,s,flow.Time,'previous','extrap');
      test.verifyEqual(flow.Data(sf~=4),zeros(nnz(sf~=4),1),'AbsTol',1e-9,'flow only in Drain');
      changed=s([true;diff(s)~=0]); pairs=[changed(1:end-1) changed(2:end)];
      allowed=[0 1;1 2;2 3;3 4;4 5;5 1];
      test.verifyTrue(all(ismember(pairs,allowed,'rows')),'legal state sequence');

  case "disabledVatStaysIdle" [baseline]
    description: A disabled vat remains idle with negligible flow and power.
    tags: behavior
    model BehCookVat, mode Normal, stop time 1000
    input "BehaviorComponentInputs.mat" (active)
    baseline "BehCookVat_disabled.mat"
      outflow_bps:1: abs tol 0.005, leading tol 5, lagging tol 5
      power_kW:1: abs tol 0.8, leading tol 5, lagging tol 5
      vatTemp_C:1: abs tol 1, leading tol 5, lagging tol 5
      state:1: leading tol 5, lagging tol 5
      hopperLevel_bowls:1: abs tol 1, leading tol 5, lagging tol 5
    custom criteria:
      y = test.sltest_simout.get('yout'); flow=y{1}.Values;
      power=y{2}.Values.Data; state=y{4}.Values.Data;
      test.verifyEqual(double(unique(state)),0,'Idle state');
      test.verifyLessThan(trapz(flow.Time,flow.Data),0.1,'negligible flow');
      test.verifyEqual(mean(power),0,'AbsTol',1e-6,'zero mean power');

suite "Packager"
  tags: behavior

  case "capacityLimitedSteadyState" [baseline]
    description: Abundant supply saturates packaging at rated capacity.
    tags: behavior
    model BehPackager, mode Normal, stop time 900
    input "BehaviorComponentInputs.mat" (active)
    baseline "BehPackager_capacity.mat"
      outflow_bps:1: abs tol 0.001111111, leading tol 5, lagging tol 5
    custom criteria:
      y=test.sltest_simout.get('yout');
      test.verifyEqual(y{1}.Values.Data(end),0.055555555555555552,'RelTol',0.02,'rated flow');

  case "supplyLimitedPassThrough" [baseline]
    description: Supply below capacity passes through at steady state.
    tags: behavior
    model BehPackager, mode Normal, stop time 900
    input "BehaviorComponentInputs.mat" (active)
    baseline "BehPackager_supplyLimited.mat"
      outflow_bps:1: abs tol 0.001111111, leading tol 5, lagging tol 5
    custom criteria:
      y=test.sltest_simout.get('yout');
      test.verifyEqual(y{1}.Values.Data(end),0.02,'RelTol',0.02,'supply pass-through');

  case "disabledPackagerProducesNothing" [baseline]
    description: A disabled packager produces no output.
    tags: behavior
    model BehPackager, mode Normal, stop time 400
    input "BehaviorComponentInputs.mat" (active)
    baseline "BehPackager_disabled.mat"
      outflow_bps:1: abs tol 0.001111111, leading tol 5, lagging tol 5
    custom criteria:
      y=test.sltest_simout.get('yout');
      test.verifyEqual(y{1}.Values.Data(end),0,'AbsTol',9.9999999999999995e-07,'zero flow');

suite "PrepUnit"
  tags: behavior

  case "capacityLimitedSteadyState" [baseline]
    description: Abundant supply saturates preparation flow and demand at capacity.
    tags: behavior
    model BehPrepUnit, mode Normal, stop time 1200
    input "BehaviorComponentInputs.mat" (active)
    baseline "BehPrepUnit_capacity.mat"
      outflow_bps:1: abs tol 0.0005555556, leading tol 5, lagging tol 5
      demand_bps:1: abs tol 0.0005555556, leading tol 5, lagging tol 5
    custom criteria:
      y=test.sltest_simout.get('yout');
      test.verifyEqual(y{1}.Values.Data(end),100/3600,'RelTol',0.02,'rated flow');
      test.verifyEqual(y{2}.Values.Data(end),100/3600,'RelTol',0.02,'rated demand');

  case "supplyLimitedSteadyState" [baseline]
    description: Supply below capacity passes through at steady state.
    tags: behavior
    model BehPrepUnit, mode Normal, stop time 1200
    input "BehaviorComponentInputs.mat" (active)
    baseline "BehPrepUnit_supplyLimited.mat"
      outflow_bps:1: abs tol 0.0005555556, leading tol 5, lagging tol 5
      demand_bps:1: abs tol 0.0005555556, leading tol 5, lagging tol 5
    custom criteria:
      y=test.sltest_simout.get('yout');
      test.verifyEqual(y{1}.Values.Data(end),0.01,'RelTol',0.02,'supply pass-through');

  case "disabledUnitProducesNothing" [baseline]
    description: A disabled preparation unit produces no output or demand.
    tags: behavior
    model BehPrepUnit, mode Normal, stop time 600
    input "BehaviorComponentInputs.mat" (active)
    baseline "BehPrepUnit_disabled.mat"
      outflow_bps:1: abs tol 0.0005555556, leading tol 5, lagging tol 5
      demand_bps:1: abs tol 0.0005555556, leading tol 5, lagging tol 5
    custom criteria:
      y=test.sltest_simout.get('yout');
      test.verifyEqual(y{1}.Values.Data(end),0,'AbsTol',1e-6,'zero flow');
      test.verifyEqual(y{2}.Values.Data(end),0,'AbsTol',1e-9,'zero demand');

suite "QCStation"
  tags: behavior

  case "passRejectSplitRatio" [baseline]
    description: Inspection splits flow according to the configured reject fraction.
    tags: behavior
    model BehQCStation, mode Normal, stop time 2000
    parameter set "overrides": CalibPeriod_s = 1000000
    input "BehaviorComponentInputs.mat" (active)
    baseline "BehQCStation_split.mat"
      passflow_bps:1: abs tol 0.000392, leading tol 5, lagging tol 5
      rejectflow_bps:1: abs tol 8e-06, leading tol 5, lagging tol 5
      calibrating:1: leading tol 1, lagging tol 1
      contamDetected_bps:1: abs tol 1e-09, leading tol 5, lagging tol 5
      contamEscaped_bps:1: abs tol 1e-09, leading tol 5, lagging tol 5
    custom criteria:
      y=test.sltest_simout.get('yout'); pass=y{1}.Values; reject=y{2}.Values.Data;
      sel=pass.Time>=1500; p=mean(pass.Data(sel)); r=mean(reject(sel));
      test.verifyEqual(p/(p+r),0.98,'RelTol',0.01,'pass/reject ratio');
      test.verifyEqual(p+r,0.02,'RelTol',0.02,'mass conservation');

  case "calibrationOutageBlocksFlow" [baseline]
    description: Calibration creates a visible outage in the pass stream.
    tags: behavior
    model BehQCStation, mode Normal, stop time 800
    parameter set "overrides": CalibPeriod_s = 300, CalibTime_s = 100
    input "BehaviorComponentInputs.mat" (active)
    baseline "BehQCStation_calibration.mat"
      passflow_bps:1: abs tol 0.000392, leading tol 5, lagging tol 5
      rejectflow_bps:1: abs tol 8e-06, leading tol 5, lagging tol 5
      calibrating:1: leading tol 1, lagging tol 1
      contamDetected_bps:1: abs tol 1e-09, leading tol 5, lagging tol 5
      contamEscaped_bps:1: abs tol 1e-09, leading tol 5, lagging tol 5
    custom criteria:
      y=test.sltest_simout.get('yout'); pass=y{1}.Values; calib=y{3}.Values.Data;
      test.verifyEqual(max(calib),1,'AbsTol',1e-9,'calibration entered');
      sel=pass.Time>=310 & pass.Time<=390;
      test.verifyLessThan(mean(pass.Data(sel)),0.1*0.02*0.98,'outage flow');

  case "contaminationDetectionSplit" [baseline]
    description: Detected contamination moves from the pass stream to rejects.
    tags: behavior
    model BehQCStation, mode Normal, stop time 2000
    parameter set "overrides": CalibPeriod_s = 1000000, ContamIncidence = 0.05, DetectSensitivity = 0.995
    input "BehaviorComponentInputs.mat" (active)
    baseline "BehQCStation_contamination.mat"
      passflow_bps:1: abs tol 0.000392, leading tol 5, lagging tol 5
      rejectflow_bps:1: abs tol 8e-06, leading tol 5, lagging tol 5
      calibrating:1: leading tol 1, lagging tol 1
      contamDetected_bps:1: abs tol 2e-05, leading tol 5, lagging tol 5
      contamEscaped_bps:1: abs tol 1e-07, leading tol 5, lagging tol 5
    custom criteria:
      y=test.sltest_simout.get('yout'); pass=y{1}.Values; reject=y{2}.Values.Data;
      det=y{4}.Values.Data; esc=y{5}.Values.Data; sel=pass.Time>=1500;
      p=mean(pass.Data(sel)); r=mean(reject(sel)); d=mean(det(sel)); e=mean(esc(sel));
      passQ=0.02*0.98; contam=passQ*0.05;
      test.verifyEqual(d,contam*0.995,'RelTol',0.01,'detected split');
      test.verifyEqual(e,contam*0.005,'RelTol',0.01,'escaped split');
      test.verifyEqual(d/(d+e),0.995,'RelTol',1e-6,'sensitivity exact');
      test.verifyEqual(p,passQ-d,'RelTol',0.01,'pass loses detected');
      test.verifyEqual(r,0.02*0.02+d,'RelTol',0.01,'reject gains detected');
      test.verifyEqual(p+r,0.02,'RelTol',0.02,'mass conservation');

  case "disabledStationBlocksFlow" [baseline]
    description: A disabled QC station blocks the pass stream.
    tags: behavior
    model BehQCStation, mode Normal, stop time 200
    input "BehaviorComponentInputs.mat" (active)
    baseline "BehQCStation_disabled.mat"
      passflow_bps:1: abs tol 0.000392, leading tol 5, lagging tol 5
      rejectflow_bps:1: abs tol 8e-06, leading tol 5, lagging tol 5
      calibrating:1: leading tol 1, lagging tol 1
      contamDetected_bps:1: abs tol 1e-09, leading tol 5, lagging tol 5
      contamEscaped_bps:1: abs tol 1e-09, leading tol 5, lagging tol 5
    custom criteria:
      y=test.sltest_simout.get('yout');
      test.verifyEqual(y{1}.Values.Data(end),0,'AbsTol',9.9999999999999995e-07,'zero pass flow');

suite "Storage"
  tags: behavior

  case "conservationOfMass" [baseline]
    description: Stored level follows the inflow-minus-draw mass balance.
    tags: behavior
    model BehStorage, mode Normal, stop time 1000
    input "BehaviorComponentInputs.mat" (active)
    baseline "BehStorage_conservation.mat"
      outflow_bps:1: abs tol 0.005, leading tol 5, lagging tol 5
      level_bowls:1: abs tol 6, leading tol 5, lagging tol 5
      starved:1: leading tol 1, lagging tol 1
    custom criteria:
      y=test.sltest_simout.get('yout'); out=y{1}.Values.Data; level=y{2}.Values.Data;
      test.verifyEqual(level(end),600,'RelTol',0.01,'mass balance');
      test.verifyEqual(mean(out(end-5:end)),0.1,'RelTol',0.05,'draw tracking');

  case "starvationDropsOutflow" [baseline]
    description: A nearly empty store becomes starved and chokes output.
    tags: behavior
    model BehStorage, mode Normal, stop time 200
    parameter set "overrides": InitLevel_bowls = 1
    input "BehaviorComponentInputs.mat" (active)
    baseline "BehStorage_starvation.mat"
      outflow_bps:1: abs tol 0.005, leading tol 5, lagging tol 5
      level_bowls:1: abs tol 6, leading tol 5, lagging tol 5
      starved:1: leading tol 1, lagging tol 1
    custom criteria:
      y=test.sltest_simout.get('yout'); out=y{1}.Values; level=y{2}.Values.Data; starved=y{3}.Values.Data;
      test.verifyLessThan(level(end),0.5,'near-empty level');
      test.verifyEqual(starved(end),1,'AbsTol',1e-9,'starved flag');
      sel=out.Time>=100; test.verifyLessThan(mean(out.Data(sel)),0.05,'choked output');

  case "capacityClamp" [baseline]
    description: Storage level saturates at capacity without overshoot.
    tags: behavior
    model BehStorage, mode Normal, stop time 100
    parameter set "overrides": InitLevel_bowls = 990
    input "BehaviorComponentInputs.mat" (active)
    baseline "BehStorage_capacity.mat"
      outflow_bps:1: abs tol 0.005, leading tol 5, lagging tol 5
      level_bowls:1: abs tol 6, leading tol 5, lagging tol 5
      starved:1: leading tol 1, lagging tol 1
    custom criteria:
      y=test.sltest_simout.get('yout'); level=y{2}.Values.Data;
      test.verifyEqual(level(end),1000,'RelTol',0.005,'capacity reached');
      test.verifyLessThanOrEqual(max(level),1000+1e-6,'no overshoot');

suite "Supervisor"
  tags: behavior

  case "modeSequenceFollowsHealthAndFlow" [baseline]
    description: Supervisor follows startup, running, degraded, and recovery phases.
    tags: behavior
    model BehSupervisor, mode Normal, stop time 300
    input "BehaviorComponentInputs.mat" (active)
    baseline "BehSupervisor_sequence.mat"
      lineEnable:1: leading tol 0.01, lagging tol 0.01
      plantMode:1: leading tol 0.01, lagging tol 0.01
    custom criteria:
      y=test.sltest_simout.get('yout'); mode=y{2}.Values;
      m=double(mode.Data); t=mode.Time;
      test.verifyEqual(m(find(t<10,1,'last')),0,'startup mode');
      test.verifyEqual(m(find(t>=10 & t<100,1,'last')),1,'running mode');
      test.verifyEqual(m(find(t>=100 & t<200,1,'last')),2,'degraded mode');
      test.verifyEqual(m(end),1,'recovered mode');

  case "lineEnableTracksHealth" [baseline]
    description: Line 2 enable follows its health input through fault and recovery.
    tags: behavior
    model BehSupervisor, mode Normal, stop time 300
    input "BehaviorComponentInputs.mat" (active)
    baseline "BehSupervisor_lineEnable.mat"
      lineEnable:1: leading tol 0.01, lagging tol 0.01
      plantMode:1: leading tol 0.01, lagging tol 0.01
    custom criteria:
      y=test.sltest_simout.get('yout'); enable=y{1}.Values; line2=enable.Data(:,2); t=enable.Time;
      test.verifyEqual(line2(find(t>=150 & t<200,1,'last')),0,'AbsTol',1e-9,'disabled while unhealthy');
      test.verifyEqual(line2(find(t>=250,1,'last')),1,'AbsTol',1e-9,'enabled after recovery');

  case "startupHoldsAllLinesEnabled" [baseline]
    description: Startup keeps every healthy line enabled before flow begins.
    tags: behavior
    model BehSupervisor, mode Normal, stop time 5
    input "BehaviorComponentInputs.mat" (active)
    baseline "BehSupervisor_startup.mat"
      lineEnable:1: leading tol 0.01, lagging tol 0.01
      plantMode:1: leading tol 0.01, lagging tol 0.01
    custom criteria:
      y=test.sltest_simout.get('yout');
      test.verifyEqual(double(y{2}.Values.Data(end)),0,'startup mode');
      test.verifyEqual(y{1}.Values.Data(end,:),ones(1,4),'AbsTol',1e-9,'all lines enabled');