test file "GalacticSoupSystemTests"

suite "Nominal"

  case "HyperCook nominal" [simulation]
    model PhysicalHyperCook, harness HyperCookSystemHarness, stop time 14400
    custom criteria:
      yout = test.sltest_simout.get('yout');
      flow = []; power = []; mode = [];
      for i = 1:yout.numElements
          e = yout{i}; v = e.Values;
          if isstruct(v) && isfield(v,'flow_bps'), flow = v.flow_bps; end
          if strcmp(e.Name, 'totalPower_kW'), power = v; end
          if strcmp(e.Name, 'plantMode'), mode = v; end
      end
      sel = flow.Time > 7200;
      bph = trapz(flow.Time(sel), flow.Data(sel))/(flow.Time(end)-7200)*3600;
      test.verifyGreaterThanOrEqual(bph, 200, 'SR-GS-002 floor');
      test.verifyEqual(bph, 308.4, 'AbsTol', 3, 'regression band');
      test.verifyEqual(double(mode.Data(end)), 1, 'Running mode');

  case "LeanBroth nominal - regression baseline" [simulation]
    model PhysicalLeanBroth, harness LeanBrothSystemHarness, stop time 14400
    custom criteria:
      yout = test.sltest_simout.get('yout');
      flow = []; power = []; mode = [];
      for i = 1:yout.numElements
          e = yout{i}; v = e.Values;
          if isstruct(v) && isfield(v,'flow_bps'), flow = v.flow_bps; end
          if strcmp(e.Name, 'totalPower_kW'), power = v; end
          if strcmp(e.Name, 'plantMode'), mode = v; end
      end
      sel = flow.Time > 7200;
      bph = trapz(flow.Time(sel), flow.Data(sel))/(flow.Time(end)-7200)*3600;
      test.verifyEqual(bph, 196.8, 'AbsTol', 3, 'regression band');
      test.verifyEqual(double(mode.Data(end)), 1, 'Running mode');

  case "EverSimmer nominal" [simulation]
    model PhysicalEverSimmer, harness EverSimmerSystemHarness, stop time 14400
    custom criteria:
      yout = test.sltest_simout.get('yout');
      flow = []; power = []; mode = [];
      for i = 1:yout.numElements
          e = yout{i}; v = e.Values;
          if isstruct(v) && isfield(v,'flow_bps'), flow = v.flow_bps; end
          if strcmp(e.Name, 'totalPower_kW'), power = v; end
          if strcmp(e.Name, 'plantMode'), mode = v; end
      end
      sel = flow.Time > 7200;
      bph = trapz(flow.Time(sel), flow.Data(sel))/(flow.Time(end)-7200)*3600;
      test.verifyGreaterThanOrEqual(bph, 200, 'SR-GS-002 floor');
      lg = test.sltest_simout.get('logsout');
      vt = lg.get('vatTemp_Cell1').Values;
      vs = lg.get('vatState_Cell1').Values;
      drainT = vs.Time(vs.Data == 4);
      test.verifyNotEmpty(drainT, 'vat never drained');
      servT = interp1(vt.Time, vt.Data, drainT);
      test.verifyLessThanOrEqual(max(servT), 95, 'SR-GS-008 serving <= 95 C');
      test.verifyGreaterThanOrEqual(min(servT), 70, 'SR-GS-008 serving >= 70 C');
      test.verifyEqual(bph, 231.9, 'AbsTol', 3, 'regression band');
      test.verifyEqual(double(mode.Data(end)), 1, 'Running mode');

suite "WorstFault"

  case "HyperCook worst fault - regression baseline" [simulation]
    model PhysicalHyperCook, harness HyperCookSystemHarness, stop time 21600
    parameter set "worstFault": Fault_T_QC = 7200
    custom criteria:
      yout = test.sltest_simout.get('yout');
      flow = []; power = []; mode = [];
      for i = 1:yout.numElements
          e = yout{i}; v = e.Values;
          if isstruct(v) && isfield(v,'flow_bps'), flow = v.flow_bps; end
          if strcmp(e.Name, 'totalPower_kW'), power = v; end
          if strcmp(e.Name, 'plantMode'), mode = v; end
      end
      pre  = flow.Time > 3600  & flow.Time < 7200;
      post = flow.Time > 14400;
      preR  = trapz(flow.Time(pre),  flow.Data(pre))/3600;
      postR = trapz(flow.Time(post), flow.Data(post))/7200;
      retention = postR/preR;
      test.verifyEqual(retention, 0, 'AbsTol', 0.02, 'worst-fault retention');

  case "LeanBroth worst fault - regression baseline" [simulation]
    model PhysicalLeanBroth, harness LeanBrothSystemHarness, stop time 21600
    parameter set "worstFault": Fault_T_Prep = 7200
    custom criteria: same code as in custom criteria of case "HyperCook worst fault - regression baseline"

  case "EverSimmer worst fault" [simulation]
    model PhysicalEverSimmer, harness EverSimmerSystemHarness, stop time 21600
    parameter set "worstFault": Fault_T_Cell1 = 7200
    custom criteria:
      yout = test.sltest_simout.get('yout');
      flow = []; power = []; mode = [];
      for i = 1:yout.numElements
          e = yout{i}; v = e.Values;
          if isstruct(v) && isfield(v,'flow_bps'), flow = v.flow_bps; end
          if strcmp(e.Name, 'totalPower_kW'), power = v; end
          if strcmp(e.Name, 'plantMode'), mode = v; end
      end
      pre  = flow.Time > 3600  & flow.Time < 7200;
      post = flow.Time > 14400;
      preR  = trapz(flow.Time(pre),  flow.Data(pre))/3600;
      postR = trapz(flow.Time(post), flow.Data(post))/7200;
      retention = postR/preR;
      test.verifyEqual(double(mode.Data(end)), 2, 'Degraded mode');
      test.verifyEqual(retention, 0.672, 'AbsTol', 0.02, 'worst-fault retention');

suite "StartupReadiness"

  case "HyperCook startup" [simulation]
    model PhysicalHyperCook, harness HyperCookSystemHarness, stop time 14400
    custom criteria:
      yout = test.sltest_simout.get('yout');
      flow = []; power = []; mode = [];
      for i = 1:yout.numElements
          e = yout{i}; v = e.Values;
          if isstruct(v) && isfield(v,'flow_bps'), flow = v.flow_bps; end
          if strcmp(e.Name, 'totalPower_kW'), power = v; end
          if strcmp(e.Name, 'plantMode'), mode = v; end
      end
      lg = test.sltest_simout.get('logsout');
      nm = string(lg.getElementNames());
      if any(nm == "soupFlow_bps")
          soup = lg.get('soupFlow_bps').Values;
      else
          cs = nm(startsWith(nm, "soupFlow_Cell"));
          soup = lg.get(char(cs(1))).Values;
          for q = 2:numel(cs)
              soup = soup + resample(lg.get(char(cs(q))).Values, soup.Time);
          end
      end
      sm = gsStartupMetrics(struct('flow',flow,'soup',soup,'mode',mode,'power',power), struct('SteadyStart_s',7200));
      test.verifyLessThanOrEqual(sm.TimeToFirstSoup_s, 4500, 'SR-GS-025.1 first soup');
      test.verifyLessThanOrEqual(sm.TimeToNominal_s, 7200, 'SR-GS-025.2 nominal rate');

  case "LeanBroth startup" [simulation]
    model PhysicalLeanBroth, harness LeanBrothSystemHarness, stop time 14400
    custom criteria: same code as in custom criteria of case "HyperCook startup"

  case "EverSimmer startup" [simulation]
    model PhysicalEverSimmer, harness EverSimmerSystemHarness, stop time 14400
    custom criteria: same code as in custom criteria of case "HyperCook startup"

suite "GravityExtremes"

  case "HyperCook at 0.1 g" [simulation]
    model PhysicalHyperCook, harness HyperCookSystemHarness, stop time 14400
    parameter set "gravity": Gravity_g = 0.1
    custom criteria:
      yout = test.sltest_simout.get('yout');
      flow = []; power = []; mode = [];
      for i = 1:yout.numElements
          e = yout{i}; v = e.Values;
          if isstruct(v) && isfield(v,'flow_bps'), flow = v.flow_bps; end
          if strcmp(e.Name, 'totalPower_kW'), power = v; end
          if strcmp(e.Name, 'plantMode'), mode = v; end
      end
      sel = flow.Time > 7200;
      bph = trapz(flow.Time(sel), flow.Data(sel))/(flow.Time(end)-7200)*3600;
      test.verifyGreaterThanOrEqual(bph, 200, 'SR-GS-002 floor');
      test.verifyEqual(bph, 308.4, 'AbsTol', 3, 'regression band');
      lg = test.sltest_simout.get('logsout');
      g_ = lg.get('ambientGravity').Values;
      test.verifyEqual(mean(g_.Data), 0.1, 'AbsTol', 1e-9, 'live AmbientGravity input');

  case "HyperCook at 12 g" [simulation]
    model PhysicalHyperCook, harness HyperCookSystemHarness, stop time 14400
    parameter set "gravity": Gravity_g = 12
    custom criteria:
      yout = test.sltest_simout.get('yout');
      flow = []; power = []; mode = [];
      for i = 1:yout.numElements
          e = yout{i}; v = e.Values;
          if isstruct(v) && isfield(v,'flow_bps'), flow = v.flow_bps; end
          if strcmp(e.Name, 'totalPower_kW'), power = v; end
          if strcmp(e.Name, 'plantMode'), mode = v; end
      end
      sel = flow.Time > 7200;
      bph = trapz(flow.Time(sel), flow.Data(sel))/(flow.Time(end)-7200)*3600;
      test.verifyGreaterThanOrEqual(bph, 200, 'SR-GS-002 floor');
      test.verifyEqual(bph, 271, 'AbsTol', 3, 'regression band');
      lg = test.sltest_simout.get('logsout');
      g_ = lg.get('ambientGravity').Values;
      test.verifyEqual(mean(g_.Data), 12, 'AbsTol', 1e-9, 'live AmbientGravity input');

  case "EverSimmer at 0.1 g - regression baseline" [simulation]
    model PhysicalEverSimmer, harness EverSimmerSystemHarness, stop time 14400
    parameter set "gravity": Gravity_g = 0.1
    custom criteria:
      yout = test.sltest_simout.get('yout');
      flow = []; power = []; mode = [];
      for i = 1:yout.numElements
          e = yout{i}; v = e.Values;
          if isstruct(v) && isfield(v,'flow_bps'), flow = v.flow_bps; end
          if strcmp(e.Name, 'totalPower_kW'), power = v; end
          if strcmp(e.Name, 'plantMode'), mode = v; end
      end
      sel = flow.Time > 7200;
      bph = trapz(flow.Time(sel), flow.Data(sel))/(flow.Time(end)-7200)*3600;
      test.verifyEqual(bph, 189.3, 'AbsTol', 3, 'regression band');
      lg = test.sltest_simout.get('logsout');
      g_ = lg.get('ambientGravity').Values;
      test.verifyEqual(mean(g_.Data), 0.1, 'AbsTol', 1e-9, 'live AmbientGravity input');

suite "Contamination"

  case "HyperCook contamination 2 percent" [simulation]
    model PhysicalHyperCook, harness HyperCookSystemHarness, stop time 14400
    parameter set "contamination": QC_ContamIncidence = 0.02
    custom criteria:
      yout = test.sltest_simout.get('yout');
      flow = []; power = []; mode = [];
      for i = 1:yout.numElements
          e = yout{i}; v = e.Values;
          if isstruct(v) && isfield(v,'flow_bps'), flow = v.flow_bps; end
          if strcmp(e.Name, 'totalPower_kW'), power = v; end
          if strcmp(e.Name, 'plantMode'), mode = v; end
      end
      sel = flow.Time > 7200;
      bph = trapz(flow.Time(sel), flow.Data(sel))/(flow.Time(end)-7200)*3600;
      test.verifyGreaterThanOrEqual(bph, 200, 'SR-GS-002 floor');
      test.verifyEqual(bph, 302.3, 'AbsTol', 3, 'regression band');
      lg = test.sltest_simout.get('logsout');
      det = lg.get('contamDetected_bps').Values;
      esc = lg.get('contamEscaped_bps').Values;
      sens = trapz(det.Time,det.Data)/(trapz(det.Time,det.Data)+trapz(esc.Time,esc.Data));
      test.verifyGreaterThanOrEqual(sens, 0.99, 'SR-GS-007 sensitivity floor');
      test.verifyEqual(sens, 0.995, 'AbsTol', 1e-3, 'design sensitivity');

  case "EverSimmer contamination 2 percent" [simulation]
    model PhysicalEverSimmer, harness EverSimmerSystemHarness, stop time 14400
    parameter set "contamination": QC_ContamIncidence = 0.02
    custom criteria:
      yout = test.sltest_simout.get('yout');
      flow = []; power = []; mode = [];
      for i = 1:yout.numElements
          e = yout{i}; v = e.Values;
          if isstruct(v) && isfield(v,'flow_bps'), flow = v.flow_bps; end
          if strcmp(e.Name, 'totalPower_kW'), power = v; end
          if strcmp(e.Name, 'plantMode'), mode = v; end
      end
      sel = flow.Time > 7200;
      bph = trapz(flow.Time(sel), flow.Data(sel))/(flow.Time(end)-7200)*3600;
      test.verifyGreaterThanOrEqual(bph, 200, 'SR-GS-002 floor');
      test.verifyEqual(bph, 227.3, 'AbsTol', 3, 'regression band');
      lg = test.sltest_simout.get('logsout');
      det = lg.get('contamDetected_bps').Values;
      esc = lg.get('contamEscaped_bps').Values;
      sens = trapz(det.Time,det.Data)/(trapz(det.Time,det.Data)+trapz(esc.Time,esc.Data));
      test.verifyGreaterThanOrEqual(sens, 0.99, 'SR-GS-007 sensitivity floor');
      test.verifyEqual(sens, 0.995, 'AbsTol', 1e-3, 'design sensitivity');

suite "TransportLoading"

  case "HyperCook transport loading" [simulation]
    model PhysicalHyperCook, harness HyperCookSystemHarness, stop time 14400
    custom criteria:
      lg = test.sltest_simout.get('logsout');
      pk = lg.get('packedFlow_bps').Values; ld = lg.get('loadedFlow_bps').Values;
      cumP = cumtrapz(pk.Time, pk.Data); cumL = cumtrapz(ld.Time, ld.Data);
      Xs = linspace(0.2, 0.8, 13) * min(cumP(end), cumL(end));
      lag = zeros(size(Xs));
      for k = 1:numel(Xs)
          tP = interp1(cumP + (1:numel(cumP))'*1e-9, pk.Time, Xs(k));
          tL = interp1(cumL + (1:numel(cumL))'*1e-9, ld.Time, Xs(k));
          lag(k) = tL - tP;
      end
      lag = median(lag);
      test.verifyLessThanOrEqual(lag, 600, 'SR-GS-006 ten-minute limit');
      test.verifyEqual(lag, 30, 'AbsTol', 15, 'latency regression band');

  case "LeanBroth transport loading" [simulation]
    model PhysicalLeanBroth, harness LeanBrothSystemHarness, stop time 14400
    custom criteria:
      lg = test.sltest_simout.get('logsout');
      pk = lg.get('packedFlow_bps').Values; ld = lg.get('loadedFlow_bps').Values;
      cumP = cumtrapz(pk.Time, pk.Data); cumL = cumtrapz(ld.Time, ld.Data);
      Xs = linspace(0.2, 0.8, 13) * min(cumP(end), cumL(end));
      lag = zeros(size(Xs));
      for k = 1:numel(Xs)
          tP = interp1(cumP + (1:numel(cumP))'*1e-9, pk.Time, Xs(k));
          tL = interp1(cumL + (1:numel(cumL))'*1e-9, ld.Time, Xs(k));
          lag(k) = tL - tP;
      end
      lag = median(lag);
      test.verifyLessThanOrEqual(lag, 600, 'SR-GS-006 ten-minute limit');
      test.verifyEqual(lag, 120, 'AbsTol', 15, 'latency regression band');

  case "EverSimmer transport loading" [simulation]
    model PhysicalEverSimmer, harness EverSimmerSystemHarness, stop time 14400
    custom criteria:
      lg = test.sltest_simout.get('logsout');
      pk = lg.get('packedFlow_bps').Values; ld = lg.get('loadedFlow_bps').Values;
      cumP = cumtrapz(pk.Time, pk.Data); cumL = cumtrapz(ld.Time, ld.Data);
      Xs = linspace(0.2, 0.8, 13) * min(cumP(end), cumL(end));
      lag = zeros(size(Xs));
      for k = 1:numel(Xs)
          tP = interp1(cumP + (1:numel(cumP))'*1e-9, pk.Time, Xs(k));
          tL = interp1(cumL + (1:numel(cumL))'*1e-9, ld.Time, Xs(k));
          lag(k) = tL - tP;
      end
      lag = median(lag);
      test.verifyLessThanOrEqual(lag, 600, 'SR-GS-006 ten-minute limit');
      test.verifyEqual(lag, 60, 'AbsTol', 15, 'latency regression band');

suite "RecipeRotation"

  case "HyperCook recipe rotation" [simulation]
    model PhysicalHyperCook, harness HyperCookSystemHarness, stop time 14400
    parameter set "changeover": Recipe_Flush_s = 120
    custom criteria:
      yout = test.sltest_simout.get('yout');
      flow = []; power = []; mode = [];
      for i = 1:yout.numElements
          e = yout{i}; v = e.Values;
          if isstruct(v) && isfield(v,'flow_bps'), flow = v.flow_bps; end
          if strcmp(e.Name, 'totalPower_kW'), power = v; end
          if strcmp(e.Name, 'plantMode'), mode = v; end
      end
      sel = flow.Time > 7200;
      bph = trapz(flow.Time(sel), flow.Data(sel))/(flow.Time(end)-7200)*3600;
      test.verifyGreaterThanOrEqual(bph, 200, 'SR-GS-002 floor');
      test.verifyEqual(bph, 289, 'AbsTol', 3, 'regression band');
      lg = test.sltest_simout.get('logsout');
      r = lg.get('activeRecipe').Values;
      test.verifyGreaterThanOrEqual(numel(unique(round(r.Data))), 8, 'SR-GS-001 recipe count');

  case "EverSimmer recipe rotation" [simulation]
    model PhysicalEverSimmer, harness EverSimmerSystemHarness, stop time 14400
    custom criteria:
      yout = test.sltest_simout.get('yout');
      flow = []; power = []; mode = [];
      for i = 1:yout.numElements
          e = yout{i}; v = e.Values;
          if isstruct(v) && isfield(v,'flow_bps'), flow = v.flow_bps; end
          if strcmp(e.Name, 'totalPower_kW'), power = v; end
          if strcmp(e.Name, 'plantMode'), mode = v; end
      end
      sel = flow.Time > 7200;
      bph = trapz(flow.Time(sel), flow.Data(sel))/(flow.Time(end)-7200)*3600;
      test.verifyGreaterThanOrEqual(bph, 200, 'SR-GS-002 floor');
      test.verifyEqual(bph, 231.9, 'AbsTol', 3, 'regression band');
      lg = test.sltest_simout.get('logsout');
      r = lg.get('activeRecipe').Values;
      test.verifyGreaterThanOrEqual(numel(unique(round(r.Data))), 8, 'SR-GS-001 recipe count');

suite "StorageEndurance"

  case "HyperCook storage endurance" [simulation]
    model PhysicalHyperCook, harness HyperCookSystemHarness, stop time 46800
    parameter set "endurance": Resupply_Cutoff_T = 3600, HC_StorageInit_bowls = 22300
    custom criteria:
      yout = test.sltest_simout.get('yout');
      flow = []; power = []; mode = [];
      for i = 1:yout.numElements
          e = yout{i}; v = e.Values;
          if isstruct(v) && isfield(v,'flow_bps'), flow = v.flow_bps; end
          if strcmp(e.Name, 'totalPower_kW'), power = v; end
          if strcmp(e.Name, 'plantMode'), mode = v; end
      end
      lastIdx = find(flow.Data*3600 > 20, 1, 'last');
      test.verifyGreaterThan(flow.Time(lastIdx), 46800 - 2400, 'no starvation in window');
      post = flow.Time > 3600;
      rate = trapz(flow.Time(post), flow.Data(post))/(46800-3600)*3600;
      proj_h = 22300 / rate;
      test.verifyGreaterThanOrEqual(proj_h, 72, 'SR-GS-021 endurance floor');
      test.verifyEqual(proj_h, 72.3, 'AbsTol', 0.5, 'endurance regression band');

  case "LeanBroth storage endurance" [simulation]
    model PhysicalLeanBroth, harness LeanBrothSystemHarness, stop time 46800
    parameter set "endurance": Resupply_Cutoff_T = 3600, LB_StorageInit_bowls = 14300
    custom criteria:
      yout = test.sltest_simout.get('yout');
      flow = []; power = []; mode = [];
      for i = 1:yout.numElements
          e = yout{i}; v = e.Values;
          if isstruct(v) && isfield(v,'flow_bps'), flow = v.flow_bps; end
          if strcmp(e.Name, 'totalPower_kW'), power = v; end
          if strcmp(e.Name, 'plantMode'), mode = v; end
      end
      lastIdx = find(flow.Data*3600 > 20, 1, 'last');
      test.verifyGreaterThan(flow.Time(lastIdx), 46800 - 2400, 'no starvation in window');
      post = flow.Time > 3600;
      rate = trapz(flow.Time(post), flow.Data(post))/(46800-3600)*3600;
      proj_h = 14300 / rate;
      test.verifyGreaterThanOrEqual(proj_h, 72, 'SR-GS-021 endurance floor');
      test.verifyEqual(proj_h, 72.6, 'AbsTol', 0.5, 'endurance regression band');

  case "EverSimmer storage endurance" [simulation]
    model PhysicalEverSimmer, harness EverSimmerSystemHarness, stop time 46800
    parameter set "endurance": Resupply_Cutoff_T = 3600, ES_StorageInit_bowls = 16800
    custom criteria:
      yout = test.sltest_simout.get('yout');
      flow = []; power = []; mode = [];
      for i = 1:yout.numElements
          e = yout{i}; v = e.Values;
          if isstruct(v) && isfield(v,'flow_bps'), flow = v.flow_bps; end
          if strcmp(e.Name, 'totalPower_kW'), power = v; end
          if strcmp(e.Name, 'plantMode'), mode = v; end
      end
      lastIdx = find(flow.Data*3600 > 20, 1, 'last');
      test.verifyGreaterThan(flow.Time(lastIdx), 46800 - 2400, 'no starvation in window');
      post = flow.Time > 3600;
      rate = trapz(flow.Time(post), flow.Data(post))/(46800-3600)*3600;
      proj_h = 16800 / rate;
      test.verifyGreaterThanOrEqual(proj_h, 72, 'SR-GS-021 endurance floor');
      test.verifyEqual(proj_h, 72.8, 'AbsTol', 0.5, 'endurance regression band');

suite "RocketTurnaround"

  case "HyperCook rocket turnaround" [simulation]
    model PhysicalHyperCook, harness HyperCookSystemHarness, stop time 14400
    custom criteria:
      lg = test.sltest_simout.get('logsout');
      ld = lg.get('loadedFlow_bps').Values;
      cumL = cumtrapz(ld.Time, ld.Data) + (1:numel(ld.Time))'*1e-9;
      starts = linspace(0.3, 0.7, 11) * cumL(end);
      ft = zeros(size(starts));
      for j = 1:numel(starts)
          t0 = interp1(cumL, ld.Time, starts(j));
          t1 = interp1(cumL, ld.Time, starts(j) + 60);
          ft(j) = t1 - t0;
      end
      turnaround = median(ft) + 120;
      test.verifyLessThanOrEqual(turnaround, 1200, 'SR-GS-018 twenty-minute limit');
      test.verifyEqual(turnaround, 808.1, 'AbsTol', 30, 'turnaround regression band');

  case "EverSimmer rocket turnaround" [simulation]
    model PhysicalEverSimmer, harness EverSimmerSystemHarness, stop time 14400
    custom criteria:
      lg = test.sltest_simout.get('logsout');
      ld = lg.get('loadedFlow_bps').Values;
      cumL = cumtrapz(ld.Time, ld.Data) + (1:numel(ld.Time))'*1e-9;
      starts = linspace(0.3, 0.7, 11) * cumL(end);
      ft = zeros(size(starts));
      for j = 1:numel(starts)
          t0 = interp1(cumL, ld.Time, starts(j));
          t1 = interp1(cumL, ld.Time, starts(j) + 60);
          ft(j) = t1 - t0;
      end
      turnaround = median(ft) + 120;
      test.verifyLessThanOrEqual(turnaround, 1200, 'SR-GS-018 twenty-minute limit');
      test.verifyEqual(turnaround, 1086, 'AbsTol', 30, 'turnaround regression band');

  case "LeanBroth rocket turnaround - regression baseline" [simulation]
    model PhysicalLeanBroth, harness LeanBrothSystemHarness, stop time 14400
    custom criteria:
      lg = test.sltest_simout.get('logsout');
      ld = lg.get('loadedFlow_bps').Values;
      cumL = cumtrapz(ld.Time, ld.Data) + (1:numel(ld.Time))'*1e-9;
      starts = linspace(0.3, 0.7, 11) * cumL(end);
      ft = zeros(size(starts));
      for j = 1:numel(starts)
          t0 = interp1(cumL, ld.Time, starts(j));
          t1 = interp1(cumL, ld.Time, starts(j) + 60);
          ft(j) = t1 - t0;
      end
      turnaround = median(ft) + 120;
      test.verifyGreaterThan(turnaround, 1200, 'SR-GS-018 finding: retire this case if fixed');
      test.verifyEqual(turnaround, 1241.5, 'AbsTol', 30, 'turnaround regression band');